# Grasshopper definition transform_revit_ecs_to_epsg-p2326-v5738.gh (Grasshopper 1.0.8)
# Copyright: Arup
# plug-ins: eleFront, Speckle.Connector.Grasshopper

speckle_model = SpeckleModel(
    Model="7f2a89be04",
    Project="34b188cb10",
    Server="https://app.speckle.systems",
    User="80EEB7BBE4744244BEF9F42A8D144D75",
    Workspace="b6415b8ed6")
speckle_model_2 = SpeckleModel(
    Model="55ab2430e5",
    Project="34b188cb10",
    Server="https://app.speckle.systems",
    User="80EEB7BBE4744244BEF9F42A8D144D75",
    Workspace="b6415b8ed6")
load = Load(SpeckleModel=speckle_model, AutoReceive=False)
load_2 = Load(SpeckleModel=speckle_model_2, AutoReceive=False)
revit_advanced_sample_arch_spklcollectio = EleFrontDataDescription(load, ShiftDepth=0, isNameSet=True)  # "Revit Advanced Sample Arch_SpklCollection"
revit_advanced_sample_str_spklcollection = EleFrontDataDescription(load_2, ShiftDepth=0, isNameSet=True)
collection_selector = CollectionSelector(revit_advanced_sample_str_spklcollection, AutoSelectAllItems=False)
revit_advanced_sample_arch_spklcollectio_2 = EleFrontDataDescription(revit_advanced_sample_arch_spklcollectio, ShiftDepth=0, isNameSet=True)  # "Revit Advanced Sample Arch_SpklCollection"
revit_advanced_sample_str_spklcollection_2 = EleFrontDataDescription(revit_advanced_sample_str_spklcollection, ShiftDepth=0, isNameSet=True)
panel = Panel("""Speckle Data Object*
Speckle Geometry*
Speckle Block Instance*""")
query_speckle_objects = QuerySpeckleObjects(Collection=revit_advanced_sample_arch_spklcollectio_2)
query_speckle_objects_2 = QuerySpeckleObjects(Collection=revit_advanced_sample_str_spklcollection_2, Path=collection_selector)
speckle_objects = EleFrontDataDescription(query_speckle_objects, ShiftDepth=0, isNameSet=True)
speckle_objects_2 = EleFrontDataDescription(speckle_objects, ShiftDepth=0, isNameSet=True)
model_block_instance = ModelBlockInstance(BlockInstance=query_speckle_objects_2)  # -> BlockInstance, Transform, BlockDefinition
speckle_objects_3 = EleFrontDataDescription(speckle_objects_2, ShiftDepth=0, isNameSet=False)
panel_2 = Panel("""Speckle Data Object*
Speckle Geometry*
Speckle Block Instance*""")
text = Text(graft(panel))
text_2 = Text(speckle_objects_2)
match_text = MatchText(Text=text_2, Pattern=text, Case=True)
speckle_objects_4 = EleFrontDataDescription(speckle_objects_3, ShiftDepth=0, isNameSet=False)
text_3 = Text(graft(panel_2))
block_instance = BlockInstance(model_block_instance.BlockInstance)
cull_pattern = CullPattern(List=speckle_objects_4, CullPattern=match_text)
speckle_data_object = SpeckleDataObject(SpeckleDataObject=speckle_objects)  # -> SpeckleDataObject, Geometries, Name, Properties, Path
speckle_block_instance = SpeckleBlockInstance(BlockInstance=speckle_objects)  # -> BlockInstance, Definition, Transform, Name, Properties, Color, Material
filter_objects = FilterObjects(Objects=speckle_objects, Name=text_3)  # -> Objects, CulledObjects
explode_tree = ExplodeTree(Data=cull_pattern)  # -> Branch0, Branch1, Branch2
# Error: 1. Data conversion failed from Speckle Block Instance to Speckle Data Object
# Error: 1. Data conversion failed from Speckle Block Instance to Speckle Block Definition
speckle_block_instance_2 = SpeckleBlockInstance(explode_tree.Branch2)
speckle_data_object_2 = SpeckleDataObject(explode_tree.Branch0)
speckle_geometry = SpeckleGeometry(explode_tree.Branch1)
speckle_block_instance_3 = EleFrontDataDescription(speckle_block_instance_2, ShiftDepth=0, isNameSet=False)
speckle_data_object_3 = EleFrontDataDescription(speckle_data_object_2, ShiftDepth=0, isNameSet=False)
speckle_geometry_2 = EleFrontDataDescription(speckle_geometry, ShiftDepth=0, isNameSet=False)
speckle_data_object_4 = SpeckleDataObject(SpeckleDataObject=speckle_data_object_3)  # -> SpeckleDataObject, Geometries, Name, Properties, Path
speckle_block_instance_4 = SpeckleBlockInstance(BlockInstance=speckle_block_instance_3)  # -> BlockInstance, Definition, Transform, Name, Properties, Color, Material
